# Grasshopper definition 230110_S1_JamesMcBennett_Weaving.gh (Grasshopper 1.0.7)
# plug-ins: Mesh Pipe

boundingsize = Slider(100, range=0..100)
pipesegments = Slider(10, range=3..10)
crvdegree = Slider(3, range=0..3)
index = Slider(5, range=0..6)
piperadius = Slider(0.1, range=0..10)
pipecaps = Slider(1, range=0..2)
density = Slider(4, range=0..10)
height = Slider(1, range=0..25)
weavetype_0_6 = GetInteger(
    index,
    AtLeast=1,
    AtMost=1,
    Maximum=6,
    Minimum=-2147483648,
    Prompt="0-6 // 0 Tabby Weave (1-1), 1=BasketWeave (2-2), 2=BasketWeave (4-4),  3=Twill (2-2), 4=Twill (3-1), 5=Satin (4-1), 6=Satin (6-1)",
    TreeAccess=False)
boundingsize_2 = GetInteger(boundingsize, AtLeast=1, AtMost=1, Maximum=100, Minimum=-2147483648, Prompt="Recommended 100", TreeAccess=False)
density_12 = GetInteger(
    density,
    AtLeast=1,
    AtMost=1,
    Maximum=2147483647,
    Minimum=-2147483648,
    Prompt="Max 12 (Higher values would crash)",
    TreeAccess=False)
height_2 = GetInteger(height, AtLeast=1, AtMost=1, Maximum=2147483647, Minimum=-2147483648, TreeAccess=False)
crvdegree_4 = GetInteger(crvdegree, AtLeast=1, AtMost=1, Maximum=4, Minimum=-2147483648, TreeAccess=False)
pipesegments_2 = GetInteger(pipesegments, AtLeast=1, AtMost=1, Maximum=2147483647, Minimum=3, TreeAccess=False)
pipecaps_0_2 = GetInteger(
    pipecaps,
    AtLeast=1,
    AtMost=1,
    Maximum=2,
    Minimum=-2147483648,
    Prompt="0 = no caps, 1 = flat caps, 2 = round caps",
    TreeAccess=False)
piperadius_2 = GetNumber(piperadius, AtLeast=1, AtMost=1, Maximum=1.797693135e+308, Minimum=-1.797693135e+308, TreeAccess=False)
max = Maximum(A=piperadius_2, B="0.1")
max_2 = Maximum(A=pipesegments_2, B="3")
max_3 = Maximum(A=density_12, B="1")
min = Minimum(A=weavetype_0_6, B="6")
min_2 = Minimum(A=pipecaps_0_2, B="2")
min_3 = Minimum(A=crvdegree_4, B="4")
min_4 = Minimum(A=max_3, B="12")
num = Number(min)
num_2 = Number(min_3)
num_3 = Number(height_2)
num_4 = Number(max_2)
num_5 = Number(min_2)
num_6 = Number(boundingsize_2)
num_7 = Number(min_4)
num_8 = Number(max)
num_9 = Number(min)
num_10 = Number(boundingsize_2)
num_11 = Number(min_4)
num_12 = Number(height_2)
num_13 = Number(min_3)
num_14 = Number(max)
num_15 = Number(min_2)
num_16 = Number(max_2)

# ----
# Tabby  Basket Weave
_0_plain_tabby_weave = Panel("""True
False""")
_1_basket_weave_2_2 = Panel("""True
True
False
False""")
_2_basket_weave_4_4 = Panel("""True
True
True
True
False
False
False
False""")
multiplication = Multiplication(A=num_7, B=4)
filter = StreamFilter(Gate=num, Stream0=_0_plain_tabby_weave, Stream1=_1_basket_weave_2_2, Stream2=_2_basket_weave_4_4)
rectangle = Rectangle(Plane=PlaneXY(0, 0, 0), XSize=num_6, YSize=num_6, Radius=0)  # -> Rectangle, Length
not = GateNot(A=filter)
sdivide = DivideSurface(Surface=rectangle.Rectangle, UCount=multiplication, VCount=multiplication)  # -> Points, Normals, Parameters
flip = FlipMatrix(Data=sdivide.Points)
Z = UnitZ(Factor=num_3)
cull = CullPattern(List=sdivide.Points, CullPattern=filter)
cull_2 = CullPattern(List=sdivide.Points, CullPattern=not)
cull_3 = CullPattern(List=sdivide.Points, CullPattern=filter)
cull_4 = CullPattern(List=sdivide.Points, CullPattern=not)
cull_5 = CullPattern(List=flip, CullPattern=filter)
cull_6 = CullPattern(List=flip, CullPattern=not)
cull_7 = CullPattern(List=flip, CullPattern=filter)
cull_8 = CullPattern(List=flip, CullPattern=not)
neg = Negative(Value=Z)
move = Move(Geometry=cull, Motion=neg)  # -> Geometry, Transform
move_2 = Move(Geometry=cull_2, Motion=Z)  # -> Geometry, Transform
move_3 = Move(Geometry=cull_3, Motion=Z)  # -> Geometry, Transform
move_4 = Move(Geometry=cull_4, Motion=neg)  # -> Geometry, Transform
move_5 = Move(Geometry=cull_5, Motion=Z)  # -> Geometry, Transform
move_6 = Move(Geometry=cull_6, Motion=neg)  # -> Geometry, Transform
move_7 = Move(Geometry=cull_7, Motion=neg)  # -> Geometry, Transform
move_8 = Move(Geometry=cull_8, Motion=Z)  # -> Geometry, Transform
weave = Weave(Pattern=not, Stream0=move.Geometry, Stream1=move_2.Geometry, NullGaps=False)
weave_2 = Weave(Pattern=not, Stream0=move_3.Geometry, Stream1=move_4.Geometry, NullGaps=False)
weave_3 = Weave(Pattern=not, Stream0=move_7.Geometry, Stream1=move_8.Geometry, NullGaps=False)
weave_4 = Weave(Pattern=not, Stream0=move_5.Geometry, Stream1=move_6.Geometry, NullGaps=False)
not_2 = GateNot(A=filter)
intcrv = Interpolate(Vertices=weave, Degree=num_2, Periodic=False, KnotStyle=1)  # -> Curve, Length, Domain
intcrv_2 = Interpolate(Vertices=weave_2, Degree=num_2, Periodic=False, KnotStyle=1)  # -> Curve, Length, Domain
intcrv_3 = Interpolate(Vertices=weave_4, Degree=num_2, Periodic=False, KnotStyle=1)  # -> Curve, Length, Domain
intcrv_4 = Interpolate(Vertices=weave_3, Degree=num_2, Periodic=False, KnotStyle=1)  # -> Curve, Length, Domain
cull_9 = CullPattern(List=flatten(intcrv.Curve), CullPattern=filter)
cull_10 = CullPattern(List=flatten(intcrv_2.Curve), CullPattern=not_2)
cull_11 = CullPattern(List=flatten(intcrv_3.Curve), CullPattern=filter)
cull_12 = CullPattern(List=flatten(intcrv_4.Curve), CullPattern=not_2)
mpipe = MeshPipe(Curve=cull_11, Radius=num_8, Accuracy=0.2, Rotation=0, Segments=num_4, Caps=num_5)
mpipe_2 = MeshPipe(Curve=cull_12, Radius=num_8, Accuracy=0.2, Rotation=0, Segments=num_4, Caps=num_5)
mpipe_3 = MeshPipe(Curve=cull_10, Radius=num_8, Accuracy=0.2, Rotation=0, Segments=num_4, Caps=num_5)
mpipe_4 = MeshPipe(Curve=cull_9, Radius=num_8, Accuracy=0.2, Rotation=0, Segments=num_4, Caps=num_5)
mcol = MeshColours(Mesh=mpipe, Colours="#0000A5")
mcol_2 = MeshColours(Mesh=mpipe_3, Colours="#87CEFA")
mcol_3 = MeshColours(Mesh=mpipe_2, Colours="blue")
mcol_4 = MeshColours(Mesh=mpipe_4, Colours="#1E90FF")
mjoin = MeshJoin(Meshes=flatten([mcol_4, mcol_2, mcol, mcol_3]))

_5_satin_4_1 = Panel("""True
False
False
False
False
False""")
_6_satin_6_1 = Panel("""True
False
False
False
False
False
False""")
_6_satin_6_1_2 = Panel("""False
False
False
True
False
False
False""")

# ----
# Twill / Satin
# Shift Pattern
# if needed
# Satin Fix
# B Input is number of TrueFalse
# -1 to correct +1 added later
panel = Panel("6")
multiplication_2 = Multiplication(A=num_11, B=panel)
multiplication_3 = Multiplication(A=num_11, B="7")
subtraction = Subtraction(A=multiplication_3, B=1)
subtraction_2 = Subtraction(A=multiplication_2, B=1)
multiplication_4 = Multiplication(A=num_11, B="4")
_3_twill_2_2 = Panel("""True
True
False
False""")
filter_2 = StreamFilter(Gate=num_9, Stream0="0", Stream1="0", Stream2="0", Stream3="0", Stream4="1", Stream5="0", Stream6="4")
filter_3 = StreamFilter(
    Gate=num_9,
    Stream0=multiplication_4,
    Stream1=multiplication_4,
    Stream2=multiplication_4,
    Stream3=multiplication_4,
    Stream4=multiplication_4,
    Stream5=subtraction_2,
    Stream6=subtraction)
_4_twill_3_1 = Panel("""True
False
False
False""")
rectangle_2 = Rectangle(Plane=PlaneXY(0, 0, 0), XSize=num_10, YSize=num_10, Radius=0)  # -> Rectangle, Length
addition = Addition(A=filter_3, B=1)
addition_2 = Addition(A=filter_3, B=1)
sdivide_2 = DivideSurface(Surface=rectangle_2.Rectangle, UCount=filter_3, VCount=filter_3)  # -> simplify(Points), Normals, Parameters
series = Series(Start=0, Step=1, Count=addition_2)
series_2 = Series(Start=filter_2, Step=1, Count=addition)
filter_4 = StreamFilter(Gate=num_9, Stream3=_3_twill_2_2, Stream4=_4_twill_3_1, Stream5=_5_satin_4_1, Stream6=_6_satin_6_1)
flip_2 = FlipMatrix(Data=sdivide_2.Points)
shift = ShiftList(List=sdivide_2.Points, Shift=graft(series_2), Wrap=True)  # -> simplify(List)
shift_2 = ShiftList(List=flip_2, Shift=graft(series), Wrap=True)  # -> simplify(List)
Z_2 = UnitZ(Factor=num_12)
neg_2 = Negative(Value=Z_2)
cull_13 = CullPattern(List=shift, CullPattern=filter_4)
move_9 = Move(Geometry=cull_13, Motion=Z_2)  # -> Geometry, Transform

filter_5 = StreamFilter(Gate=num_9, Stream3=_3_twill_2_2, Stream4=_4_twill_3_1, Stream5=_5_satin_4_1, Stream6=_6_satin_6_1_2)
not_3 = GateNot(A=filter_5)
not_4 = GateNot(A=filter_4)

cull_14 = CullPattern(List=shift_2, CullPattern=not_3)
cull_15 = CullPattern(List=shift_2, CullPattern=filter_5)
cull_16 = CullPattern(List=shift, CullPattern=not_4)
move_10 = Move(Geometry=cull_16, Motion=neg_2)  # -> Geometry, Transform
move_11 = Move(Geometry=cull_14, Motion=Z_2)  # -> Geometry, Transform
move_12 = Move(Geometry=cull_15, Motion=neg_2)  # -> Geometry, Transform
merge = Merge(Data1=move_11.Geometry, Data2=move_12.Geometry)
merge_2 = Merge(Data1=move_9.Geometry, Data2=move_10.Geometry)
pdecon = Deconstruct(Point=merge_2)  # -> XComponent, YComponent, ZComponent
pdecon_2 = Deconstruct(Point=merge)  # -> XComponent, YComponent, ZComponent
sort = SortList(Keys=pdecon.YComponent, ValuesA=merge_2)  # -> Keys, ValuesA
sort_2 = SortList(Keys=pdecon_2.XComponent, ValuesA=merge)  # -> Keys, ValuesA

# ----
# Prevent components
# going red if basket weave
num_17 = Number(min)
smaller = SmallerThan(FirstNumber=num_17, SecondNumber="3")  # -> SmallerThan, OrEqualTo
filter_6 = StreamFilter(Gate=smaller.SmallerThan, Stream0=sort_2.ValuesA)

# ----
# Prevent components
# going red if basket weave
num_18 = Number(min)
smaller_2 = SmallerThan(FirstNumber=num_18, SecondNumber="3")  # -> SmallerThan, OrEqualTo
filter_7 = StreamFilter(Gate=smaller_2.SmallerThan, Stream0=sort.ValuesA)

intcrv_5 = Interpolate(Vertices=filter_7, Degree=num_13, Periodic=False, KnotStyle=1)  # -> Curve, Length, Domain
intcrv_6 = Interpolate(Vertices=filter_6, Degree=num_13, Periodic=False, KnotStyle=1)  # -> Curve, Length, Domain
mpipe_5 = MeshPipe(Curve=intcrv_6.Curve, Radius=num_14, Accuracy=0.2, Rotation=0, Segments=num_16, Caps=num_15)
mpipe_6 = MeshPipe(Curve=intcrv_5.Curve, Radius=num_14, Accuracy=0.2, Rotation=0, Segments=num_16, Caps=num_15)
mcol_5 = MeshColours(Mesh=mpipe_5, Colours="blue")
mcol_6 = MeshColours(Mesh=mpipe_6, Colours="#87CEFA")
mjoin_2 = MeshJoin(Meshes=flatten([mcol_6, mcol_5]))

# ----
# Error Check
# For Curve
# Intersections
swatch = ColourSwatch(SwatchColor=RGB(255, 0, 0))
ccx = CurveCurve(CurveA=intcrv_5.Curve, CurveB=intcrv_6.Curve)  # -> Points, ParamsA, ParamsB
preview = CustomPreview(Geometry=ccx.Points, Material=swatch)

mesh = Mesh([mjoin, mjoin_2])
null = NullItem(Item=mesh)  # -> NullFlags, InvalidFlags, Description
dispatch = Dispatch(List=mesh, DispatchPattern=null.NullFlags)  # -> ListA, ListB
mesh_2 = Mesh(dispatch.ListB)
context_bake = ContextBake(Geometry=mesh_2)
