# Grasshopper definition 230110_mcbennett_weaving.gh (Grasshopper 1.0.7)

boundingsize = Slider(100, range=0..100)
crvdegree = Slider(3, range=0..3)
index = Slider(0, range=0..6)
piperadius = Slider(1.25, range=0..10)
pipecaps = Slider(1, range=0..2)
density = Slider(2, range=0..10)
height = Slider(2, range=0..25)
weavetype_0_6 = GetInteger(
    index,
    AtLeast=1,
    AtMost=1,
    Maximum=6,
    Minimum=-2147483648,
    Prompt="0-6 // 0 Tabby Weave (1-1), 1=BasketWeave (2-2), 2=BasketWeave (4-4),  3=Twill (2-2), 4=Twill (3-1), 5=Satin (4-1), 6=Satin (6-1)",
    TreeAccess=False)
boundingsize_2 = GetInteger(boundingsize, AtLeast=1, AtMost=1, Maximum=100, Minimum=-2147483648, Prompt="Recommended 100", TreeAccess=False)
density_6 = GetInteger(
    density,
    AtLeast=1,
    AtMost=1,
    Maximum=2147483647,
    Minimum=-2147483648,
    Prompt="Max 6 (MeshPipe could go to 12. Higher values take too long to load.)",
    TreeAccess=False)
height_2 = GetInteger(height, AtLeast=1, AtMost=1, Maximum=2147483647, Minimum=-2147483648, TreeAccess=False)
crvdegree_4 = GetInteger(crvdegree, AtLeast=1, AtMost=1, Maximum=4, Minimum=-2147483648, TreeAccess=False)
pipecaps_0_2 = GetInteger(
    pipecaps,
    AtLeast=1,
    AtMost=1,
    Maximum=2,
    Minimum=-2147483648,
    Prompt="0 = no caps, 1 = flat caps, 2 = round caps",
    TreeAccess=False)
piperadius_min_0_1 = GetNumber(piperadius, AtLeast=1, AtMost=1, Maximum=1.797693135e+308, Minimum=-1.797693135e+308, TreeAccess=False)
max = Maximum(A=piperadius_min_0_1, B="0.1")
max_2 = Maximum(A=density_6, B="1")
min = Minimum(A=weavetype_0_6, B="6")
min_2 = Minimum(A=pipecaps_0_2, B="2")
min_3 = Minimum(A=crvdegree_4, B="4")
min_4 = Minimum(A=max_2, B="6")
num = Number(min)
num_2 = Number(min_3)
num_3 = Number(height_2)
num_4 = Number(min_2)
num_5 = Number(boundingsize_2)
num_6 = Number(min_4)
num_7 = Number(max)
num_8 = Number(min)
num_9 = Number(boundingsize_2)
num_10 = Number(min_4)
num_11 = Number(height_2)
num_12 = Number(min_3)
num_13 = Number(max)
num_14 = Number(min_2)
_5_satin_4_1 = Panel("""True
False
False
False
False
False""")
_6_satin_6_1 = Panel("""True
False
False
False
False
False
False""")
_6_satin_6_1_2 = Panel("""False
False
False
True
False
False
False""")

# ----
# Twill / Satin
# Shift Pattern
# if needed
# Satin Fix
# B Input is number of TrueFalse
# -1 to correct +1 added later
panel = Panel("6")
multiplication = Multiplication(A=num_10, B=panel)
multiplication_2 = Multiplication(A=num_10, B="7")
subtraction = Subtraction(A=multiplication_2, B=1)
subtraction_2 = Subtraction(A=multiplication, B=1)
multiplication_3 = Multiplication(A=num_10, B="4")
_3_twill_2_2 = Panel("""True
True
False
False""")
filter = StreamFilter(Gate=num_8, Stream0="0", Stream1="0", Stream2="0", Stream3="0", Stream4="1", Stream5="0", Stream6="4")
filter_2 = StreamFilter(
    Gate=num_8,
    Stream0=multiplication_3,
    Stream1=multiplication_3,
    Stream2=multiplication_3,
    Stream3=multiplication_3,
    Stream4=multiplication_3,
    Stream5=subtraction_2,
    Stream6=subtraction)
_4_twill_3_1 = Panel("""True
False
False
False""")
rectangle = Rectangle(Plane=PlaneXY(0, 0, 0), XSize=num_9, YSize=num_9, Radius=0)  # -> Rectangle, Length
addition = Addition(A=filter_2, B=1)
addition_2 = Addition(A=filter_2, B=1)
sdivide = DivideSurface(Surface=rectangle.Rectangle, UCount=filter_2, VCount=filter_2)  # -> simplify(Points), Normals, Parameters
series = Series(Start=0, Step=1, Count=addition_2)
series_2 = Series(Start=filter, Step=1, Count=addition)
filter_3 = StreamFilter(Gate=num_8, Stream3=_3_twill_2_2, Stream4=_4_twill_3_1, Stream5=_5_satin_4_1, Stream6=_6_satin_6_1)
flip = FlipMatrix(Data=sdivide.Points)
shift = ShiftList(List=sdivide.Points, Shift=graft(series_2), Wrap=True)  # -> simplify(List)
shift_2 = ShiftList(List=flip, Shift=graft(series), Wrap=True)  # -> simplify(List)
Z = UnitZ(Factor=num_11)
neg = Negative(Value=Z)
cull = CullPattern(List=shift, CullPattern=filter_3)
move = Move(Geometry=cull, Motion=Z)  # -> Geometry, Transform

filter_4 = StreamFilter(Gate=num_8, Stream3=_3_twill_2_2, Stream4=_4_twill_3_1, Stream5=_5_satin_4_1, Stream6=_6_satin_6_1_2)
not = GateNot(A=filter_4)
not_2 = GateNot(A=filter_3)

# ----
# Tabby  Basket Weave
_0_plain_tabby_weave = Panel("""True
False""")
_1_basket_weave_2_2 = Panel("""True
True
False
False""")
_2_basket_weave_4_4 = Panel("""True
True
True
True
False
False
False
False""")
multiplication_4 = Multiplication(A=num_6, B=4)
filter_5 = StreamFilter(Gate=num, Stream0=_0_plain_tabby_weave, Stream1=_1_basket_weave_2_2, Stream2=_2_basket_weave_4_4)
rectangle_2 = Rectangle(Plane=PlaneXY(0, 0, 0), XSize=num_5, YSize=num_5, Radius=0)  # -> Rectangle, Length
not_3 = GateNot(A=filter_5)
sdivide_2 = DivideSurface(Surface=rectangle_2.Rectangle, UCount=multiplication_4, VCount=multiplication_4)  # -> Points, Normals, Parameters
flip_2 = FlipMatrix(Data=sdivide_2.Points)
Z_2 = UnitZ(Factor=num_3)
cull_2 = CullPattern(List=sdivide_2.Points, CullPattern=filter_5)
cull_3 = CullPattern(List=sdivide_2.Points, CullPattern=not_3)
cull_4 = CullPattern(List=sdivide_2.Points, CullPattern=filter_5)
cull_5 = CullPattern(List=sdivide_2.Points, CullPattern=not_3)
cull_6 = CullPattern(List=flip_2, CullPattern=filter_5)
cull_7 = CullPattern(List=flip_2, CullPattern=not_3)
cull_8 = CullPattern(List=flip_2, CullPattern=filter_5)
cull_9 = CullPattern(List=flip_2, CullPattern=not_3)
neg_2 = Negative(Value=Z_2)
move_2 = Move(Geometry=cull_2, Motion=neg_2)  # -> Geometry, Transform
move_3 = Move(Geometry=cull_3, Motion=Z_2)  # -> Geometry, Transform
move_4 = Move(Geometry=cull_4, Motion=Z_2)  # -> Geometry, Transform
move_5 = Move(Geometry=cull_5, Motion=neg_2)  # -> Geometry, Transform
move_6 = Move(Geometry=cull_6, Motion=Z_2)  # -> Geometry, Transform
move_7 = Move(Geometry=cull_7, Motion=neg_2)  # -> Geometry, Transform
move_8 = Move(Geometry=cull_8, Motion=neg_2)  # -> Geometry, Transform
move_9 = Move(Geometry=cull_9, Motion=Z_2)  # -> Geometry, Transform
weave = Weave(Pattern=not_3, Stream0=move_2.Geometry, Stream1=move_3.Geometry, NullGaps=False)
weave_2 = Weave(Pattern=not_3, Stream0=move_4.Geometry, Stream1=move_5.Geometry, NullGaps=False)
weave_3 = Weave(Pattern=not_3, Stream0=move_8.Geometry, Stream1=move_9.Geometry, NullGaps=False)
weave_4 = Weave(Pattern=not_3, Stream0=move_6.Geometry, Stream1=move_7.Geometry, NullGaps=False)
not_4 = GateNot(A=filter_5)
intcrv = Interpolate(Vertices=weave, Degree=num_2, Periodic=False, KnotStyle=1)  # -> Curve, Length, Domain
intcrv_2 = Interpolate(Vertices=weave_2, Degree=num_2, Periodic=False, KnotStyle=1)  # -> Curve, Length, Domain
intcrv_3 = Interpolate(Vertices=weave_4, Degree=num_2, Periodic=False, KnotStyle=1)  # -> Curve, Length, Domain
intcrv_4 = Interpolate(Vertices=weave_3, Degree=num_2, Periodic=False, KnotStyle=1)  # -> Curve, Length, Domain
cull_10 = CullPattern(List=flatten(intcrv.Curve), CullPattern=filter_5)
cull_11 = CullPattern(List=flatten(intcrv_2.Curve), CullPattern=not_4)
cull_12 = CullPattern(List=flatten(intcrv_3.Curve), CullPattern=filter_5)
cull_13 = CullPattern(List=flatten(intcrv_4.Curve), CullPattern=not_4)

pipe = Pipe(Curve=cull_10, Radius=num_7, Caps=num_4)
pipe_2 = Pipe(Curve=cull_12, Radius=num_7, Caps=num_4)
pipe_3 = Pipe(Curve=cull_11, Radius=num_7, Caps=num_4)
pipe_4 = Pipe(Curve=cull_13, Radius=num_7, Caps=num_4)
mesh = Mesh(pipe)
mesh_2 = Mesh(pipe_2)
mesh_3 = Mesh(pipe_3)
mesh_4 = Mesh(pipe_4)

mcol = MeshColours(Mesh=mesh_2, Colours="#0000A5")
mcol_2 = MeshColours(Mesh=mesh_3, Colours="#87CEFA")
mcol_3 = MeshColours(Mesh=mesh_4, Colours="blue")
mcol_4 = MeshColours(Mesh=mesh, Colours="#1E90FF")
mjoin = MeshJoin(Meshes=flatten([mcol_4, mcol_2, mcol, mcol_3]))

cull_14 = CullPattern(List=shift_2, CullPattern=not)
cull_15 = CullPattern(List=shift_2, CullPattern=filter_4)
cull_16 = CullPattern(List=shift, CullPattern=not_2)
move_10 = Move(Geometry=cull_16, Motion=neg)  # -> Geometry, Transform
move_11 = Move(Geometry=cull_14, Motion=Z)  # -> Geometry, Transform
move_12 = Move(Geometry=cull_15, Motion=neg)  # -> Geometry, Transform
merge = Merge(Data1=move_11.Geometry, Data2=move_12.Geometry)
merge_2 = Merge(Data1=move.Geometry, Data2=move_10.Geometry)
pdecon = Deconstruct(Point=merge_2)  # -> XComponent, YComponent, ZComponent
pdecon_2 = Deconstruct(Point=merge)  # -> XComponent, YComponent, ZComponent
sort = SortList(Keys=pdecon.YComponent, ValuesA=merge_2)  # -> Keys, ValuesA
sort_2 = SortList(Keys=pdecon_2.XComponent, ValuesA=merge)  # -> Keys, ValuesA

# ----
# Prevent components
# going red if basket weave
num_15 = Number(min)
smaller = SmallerThan(FirstNumber=num_15, SecondNumber="3")  # -> SmallerThan, OrEqualTo
filter_6 = StreamFilter(Gate=smaller.SmallerThan, Stream0=sort_2.ValuesA)

# ----
# Prevent components
# going red if basket weave
num_16 = Number(min)
smaller_2 = SmallerThan(FirstNumber=num_16, SecondNumber="3")  # -> SmallerThan, OrEqualTo
filter_7 = StreamFilter(Gate=smaller_2.SmallerThan, Stream0=sort.ValuesA)

intcrv_5 = Interpolate(Vertices=filter_7, Degree=num_12, Periodic=False, KnotStyle=1)  # -> Curve, Length, Domain
intcrv_6 = Interpolate(Vertices=filter_6, Degree=num_12, Periodic=False, KnotStyle=1)  # -> Curve, Length, Domain

# ----
# Error Check
# For Curve
# Intersections
swatch = ColourSwatch(SwatchColor=RGB(255, 0, 0))
ccx = CurveCurve(CurveA=intcrv_5.Curve, CurveB=intcrv_6.Curve)  # -> Points, ParamsA, ParamsB
preview = CustomPreview(Geometry=ccx.Points, Material=swatch)

pipe_5 = Pipe(Curve=intcrv_5.Curve, Radius=num_13, Caps=num_14)
pipe_6 = Pipe(Curve=intcrv_6.Curve, Radius=num_13, Caps=num_14)
mesh_5 = Mesh(pipe_5)
mesh_6 = Mesh(pipe_6)

mcol_5 = MeshColours(Mesh=mesh_6, Colours="blue")
mcol_6 = MeshColours(Mesh=mesh_5, Colours="#87CEFA")
mjoin_2 = MeshJoin(Meshes=flatten([mcol_6, mcol_5]))

mesh_7 = Mesh([mjoin, mjoin_2])
null = NullItem(Item=mesh_7)  # -> NullFlags, InvalidFlags, Description
dispatch = Dispatch(List=mesh_7, DispatchPattern=null.NullFlags)  # -> ListA, ListB
mesh_8 = Mesh(dispatch.ListB)
context_bake = ContextBake(Geometry=mesh_8)
